# Grasshopper definition 4_Ranges_Surfaces_Fields.gh (Grasshopper 1.0.7)
# plug-ins: Pufferfish

# ---- group: Additional Topics / Genepools are collections of sliders with a fixed domain
genes = GenePool(Decimals=2, Maximum=100, Minimum=0, Value=[50, 50, 50, 50, 50, 50, 50, 50, 50, 50])

# ---- group: Additional Topics
# Animation
# Generative Design
# Clusters
galapagos = Galapagos()

# ---- group: Domains are ranges from some # to another #
domain = Domain()
# Ranges + Surfaces + Fields
# Created by: Michael Hoehn
# Last Modified: 22/02/02
# Ranges
domain_2 = Domain(Domain(0, 1))
panel = Panel(domain_2)

# ----
# Surfaces
number_slider = Slider(100, range=0..100)
box = CenterBox(Base=PlaneXY(0, 0, 0), X=number_slider, Y=number_slider, Z=number_slider)
pop3d = Populate3D(Region=box, Count=Slider(4, range=0..100), Seed=1)
lng = ListLength(List=pop3d)
partition = PartitionList(List=pop3d, Size=expr("x/2", lng))  # -> simplify(Chunks)
intcrv = Interpolate(Vertices=partition, Degree=3, Periodic=False, KnotStyle=1)  # -> flatten(Curve), Length, Domain
loft = Loft(Curves=intcrv.Curve, Options={Adjust=False, Closed=False, LoftEnds=0, LoftSimp=0, LoftType=0, Rebuild=10, Refit=0.01})
Z = UnitZ(Factor=1)
contour = Contour(Shape=loft, Point=Point(0, 0, 0), Direction=Z, Distance=Slider(4, range=0.05..10))  # -> flatten(Contours)
len = Length(Curve=contour)
division = Division(A=len, B=Slider(7.261, range=0..10))
divide = DivideCurve(Curve=contour, Count=division, Kinks=False)  # -> simplify(Points), Tangents, Parameters
flip = FlipMatrix(Data=divide.Points)
intcrv_2 = Interpolate(Vertices=flip, Degree=3, Periodic=False, KnotStyle=1)  # -> Curve, Length, Domain

# ---- group: Let's create a field of points
# Fields
number_slider_2 = Slider(1, range=0..10)
pt = ConstructPoint(XCoordinate=0, YCoordinate=0, ZCoordinate=0)
series = Series(Start=0, Step=number_slider_2, Count=Slider(50, range=0..100))
X = UnitX(Factor=series)
move = Move(Geometry=pt, Motion=X)  # -> Geometry, Transform
Y = UnitY(Factor=series)
move_2 = Move(Geometry=graft(move.Geometry), Motion=Y)  # -> Geometry, Transform

# ---- group: Alternatively you can also use a grid node
sqgrid = Square(Plane=PlaneXY(0, 0, 0), Size=1, ExtentX=5, ExtentY=5)  # -> Cells, Points
recgrid = Rectangular(Plane=PlaneXY(0, 0, 0), SizeX=1, SizeY=2, ExtentX=10, ExtentY=5)  # -> Cells, Points

# ---- group: Use a range to quickly create lots of numbers in a sequence
domain_3 = Domain(Domain(0, 1))
range = Range(Domain=domain_3, Steps=Slider(100, range=0..100))
panel_2 = Panel(range)

# ---- group: Let's operate on that field of points with an attractor
attractor_pt = Point(Point(21.79322139, 21.40479727, 1.244068781))
pt_grid = Point(Tree({0;0;0}: [Point(0, 0, 0), Point(0, 1, 0), Point(0, 2, 0), Point(0, 3, 0), Point(0, 4, 0), Point(0, 5, 0)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], {0;0;1}: [Point(1, 0, 0), Point(1, 1, 0), Point(1, 2, 0), Point(1, 3, 0), Point(1, 4, 0), Point(1, 5, 0)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], {0;0;2}: [Point(2, 0, 0), Point(2, 1, 0), Point(2, 2, 0), Point(2, 3, 0), Point(2, 4, 0), Point(2, 5, 0)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], {0;0;3}: [Point(3, 0, 0), Point(3, 1, 0), Point(3, 2, 0), Point(3, 3, 0), Point(3, 4, 0), Point(3, 5, 0)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], {0;0;4}: [Point(4, 0, 0), Point(4, 1, 0), Point(4, 2, 0), Point(4, 3, 0), Point(4, 4, 0), Point(4, 5, 0)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], {0;0;5}: [Point(5, 0, 0), Point(5, 1, 0), Point(5, 2, 0), Point(5, 3, 0), Point(5, 4, 0), Point(5, 5, 0)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]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))
dist = Distance(PointA=pt_grid, PointB=attractor_pt)
Z_2 = UnitZ(Factor=dist)
move_3 = Move(Geometry=pt_grid, Motion=Z_2)  # -> Geometry, Transform

# ---- group: Let's operate on that field of points with an attractor / Now let's modify our ranges!
division_2 = Division(A=Z_2, B=Slider(0.391, range=0..10))

# ---- group: You can even make parametric domains!
dom = ConstructDomain(DomainStart=Slider(0, range=0..100), DomainEnd=Slider(100, range=0..100))
range_2 = Range(Domain=dom, Steps=Slider(10, range=0..100))
panel_3 = Panel(range_2)

# ---- group: Let's operate on that field of points with an attractor
tstat = TreeStatistics(Tree=move_3.Geometry)  # -> Paths, Length, Count
# ???: What happens when this is connected to the contour workflow above???
srfgrid = SurfaceFromPoints(Points=flatten(move_3.Geometry), UCount=tstat.Count, Interpolate=False)

# ---- group: Domains are really useful to help build flexibility, predictability, and randomness into your algorithms
dom_2 = ConstructDomain(DomainStart=Slider(0, range=0..100), DomainEnd=Slider(100, range=0..100))
random = Random(Range=dom_2, Number=Slider(10, range=0..100), Seed=Slider(999, range=0..1000))
panel_4 = Panel(random)

# ----
# Vector Fields
number_slider_3 = Slider(100, range=0..100)
panel_5 = Panel("""0
.5""")
cir = Circle(Plane=PlaneXY(0, 0, 0), Radius=number_slider_3)
number_slider_4 = Slider(20, range=0..20)
eval = EvaluateCurve(Curve=reparameterize(cir), Parameter=panel_5)  # -> Point, Tangent, Angle
number_slider_5 = Slider(1, range=0..5)
item = ListItem(List=eval.Point, Index=0, Wrap=True)  # -> Item, Item1
sdivide = DivideSurface(Surface=cir, UCount=number_slider_4, VCount=number_slider_4)  # -> flatten(Points), Normals, Parameters
pcharge = PointCharge(Point=item.Item, Charge=1, Decay=number_slider_5)
pcharge_2 = PointCharge(Point=item.Item1, Charge=1, Decay=number_slider_5)
mergef = MergeFields(Fields=[pcharge, pcharge_2])
fline = FieldLine(Field=mergef, Point=sdivide.Points, Steps=Slider(630, range=0..10000), Accuracy=0.1, Method=3)

panel_6 = Panel("""0
.5""")
cir_2 = Circle(Plane=PlaneXY(0, 0, 0), Radius=Slider(100, range=0..100))
number_slider_6 = Slider(20, range=0..20)
eval_2 = EvaluateCurve(Curve=reparameterize(cir_2), Parameter=panel_6)  # -> Point, Tangent, Angle
number_slider_7 = Slider(1, range=0..5)
item_2 = ListItem(List=eval_2.Point, Index=0, Wrap=True)  # -> Item, Item1
sdivide_2 = DivideSurface(Surface=cir_2, UCount=number_slider_6, VCount=number_slider_6)  # -> flatten(Points), Normals, Parameters
pt_2 = Point(Point(11.02302581, -60.91144484, 0))
fspin = SpinForce(Plane=pt_2, Strength=1, Radius=Slider(25, range=0..100), Decay=2)
pcharge_3 = PointCharge(Point=item_2.Item, Charge=1, Decay=number_slider_7)
pcharge_4 = PointCharge(Point=item_2.Item1, Charge=1, Decay=number_slider_7)
mergef_2 = MergeFields(Fields=[pcharge_3, pcharge_4, fspin])
fline_2 = FieldLine(Field=mergef_2, Point=sdivide_2.Points, Steps=Slider(630, range=0..10000), Accuracy=0.1, Method=3)

crv = Curve(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)
panel_7 = Panel("""0
.5""")
cir_3 = Circle(Plane=PlaneXY(0, 0, 0), Radius=Slider(100, range=0..100))
number_slider_8 = Slider(20, range=0..20)
eval_3 = EvaluateCurve(Curve=reparameterize(crv), Parameter=Slider(0.317, range=0..1))  # -> Point, Tangent, Angle
eval_4 = EvaluateCurve(Curve=reparameterize(cir_3), Parameter=panel_7)  # -> Point, Tangent, Angle
number_slider_9 = Slider(1, range=0..5)
item_3 = ListItem(List=eval_4.Point, Index=0, Wrap=True)  # -> Item, Item1
sdivide_3 = DivideSurface(Surface=cir_3, UCount=number_slider_8, VCount=number_slider_8)  # -> flatten(Points), Normals, Parameters
fspin_2 = SpinForce(Plane=eval_3.Point, Strength=1, Radius=Slider(25, range=0..100), Decay=2)
pcharge_5 = PointCharge(Point=item_3.Item, Charge=1, Decay=number_slider_9)
pcharge_6 = PointCharge(Point=item_3.Item1, Charge=1, Decay=number_slider_9)
mergef_3 = MergeFields(Fields=[pcharge_5, pcharge_6, fspin_2])
fline_3 = FieldLine(Field=mergef_3, Point=sdivide_3.Points, Steps=Slider(630, range=0..10000), Accuracy=0.1, Method=3)

# ----
# Isovist Fields
number_slider_10 = Slider(100, range=0..100)
rectangle = Rectangle(Plane=PlaneXY(0, 0, 0), XSize=number_slider_10, YSize=number_slider_10, Radius=0)  # -> Rectangle, Length
crv_2 = Curve(rectangle.Rectangle)
i = Index(0)
pop2d = Populate2D(Region=rectangle.Rectangle, Count=Slider(13, range=0..50), Seed=1)
cull_i = CullIndex(List=pop2d, Indices=i, Wrap=True)
item_4 = ListItem(List=pop2d, Index=i, Wrap=True)
cir_4 = Circle(Plane=cull_i, Radius=Slider(8, range=0..100))
polygon = Polygon(Plane=item_4, Radius=3, Segments=6, FilletRadius=0)  # -> Polygon, Length
merge = Merge(Data1=flatten(crv_2), Data2=flatten(cir_4))  # -> flatten(Result)
ivist = IsoVist(Plane=item_4, Count=Slider(208, range=0..500), Radius=Slider(300, range=0..500), Obstacles=merge)  # -> Points, Distance, Index
intcrv_3 = Interpolate(Vertices=ivist.Points, Degree=3, Periodic=invert(False), KnotStyle=2)  # -> Curve, Length, Domain

number_slider_11 = Slider(214, range=0..1000)
number_slider_12 = Slider(43, range=0..100)
# Advanced Isovist
number_slider_13 = Slider(1.105, range=0..10)
number_slider_14 = Slider(3278, range=0..10000)
dom_3 = ConstructDomain(DomainStart=number_slider_13, DomainEnd=Slider(10, range=0..10))
dom_4 = ConstructDomain(DomainStart=expr("x/2", number_slider_11), DomainEnd=expr("-x/2", number_slider_11))
rectangle_2 = Rectangle(Plane=PlaneXY(0, 0, 0), XSize=dom_4, YSize=dom_4, Radius=0)  # -> Rectangle, Length
random_2 = Random(Range=dom_3, Number=number_slider_12, Seed=number_slider_14)
crv_3 = Curve(rectangle_2.Rectangle)
dom_5 = ConstructDomain(DomainStart=expr("x/2", random_2), DomainEnd=expr("-x/2", random_2))
dom_6 = ConstructDomain(DomainStart=Slider(0.646, range=0..100), DomainEnd=Slider(5.458, range=0..100))
pop2d_2 = Populate2D(Region=crv_3, Count=number_slider_12, Seed=number_slider_14)
random_3 = Random(Range=dom_6, Number=number_slider_12, Seed=number_slider_14)
number_slider_15 = Slider(0, range=0..100)
dispdexs = DispatchIndices(List=pop2d_2, Indices=number_slider_15)  # -> AtI, NotI
Z_3 = UnitZ(Factor=1)
srf = Surface(crv_3)

# ---- group: Alternative Shapes
cir_5 = Circle(Plane=pop2d_2, Radius=random_3)
rectangle_3 = Rectangle(Plane=pop2d_2, XSize=dom_5, YSize=dom_5, Radius=0)  # -> Rectangle, Length

# ----
dispdexs_2 = DispatchIndices(List=rectangle_3.Rectangle, Indices=number_slider_15)  # -> AtI, NotI
merge_2 = Merge(Data1=dispdexs_2.NotI, Data2=crv_3)  # -> flatten(Result)
ivist_2 = IsoVist(Plane=dispdexs.AtI, Count=Slider(1000, range=0..1000), Radius=Slider(230, range=0..1000), Obstacles=merge_2)  # -> simplify(Points), Distance, Index
intcrv_4 = Interpolate(Vertices=ivist_2.Points, Degree=3, Periodic=invert(False), KnotStyle=Slider(2, range=0..2))  # -> Curve, Length, Domain
srf_2 = Surface(intcrv_4.Curve)
move_4 = Move(Geometry=srf_2, Motion=Z_3)  # -> Geometry, Transform

# ---- group: Preview
preview = CustomPreview(Geometry=srf, Material=ColourSwatch(SwatchColor=RGB(0, 0, 0)))
preview_2 = CustomPreview(Geometry=move_4.Geometry, Material=ColourSwatch(SwatchColor=RGB(255, 255, 255)))
