# Grasshopper definition Grasshopper Representation_01.gh (Grasshopper 1.0.7)
# plug-ins: Human

# ----
# Using Gradients!
number_slider = Slider(44, range=0..100)
series = Series(Start=0, Step=1, Count=number_slider)
X = UnitX(Factor=series)
crv = Curve(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)
move = Move(Geometry=crv, Motion=X)  # -> Geometry, Transform
curvepoint = PointOnCurve(move.Geometry, parameter=0.5)
series_2 = Series(Start=0, Step=Slider(4.597, range=0..10), Count=number_slider)
rotate = Rotate(Geometry=move.Geometry, Angle=degrees(series_2), Plane=curvepoint)  # -> Geometry, Transform
curvepoint_2 = PointOnCurve(rotate.Geometry, parameter=0.5)
series_3 = Series(Start=Slider(0.0167, range=0..1), Step=Slider(0.0493, range=0..1), Count=number_slider)
scale = Scale(Geometry=rotate.Geometry, Center=curvepoint_2, Factor=series_3)  # -> Geometry, Transform
len = Length(Curve=scale.Geometry)
bnd = Bounds(Numbers=len)
dedomain = DeconstructDomain(Domain=bnd)  # -> Start, End
gradient = Gradient(
    LowerLimit=dedomain.Start,
    UpperLimit=dedomain.End,
    Parameter=len,
    stops=[0: RGB(0, 128, 0), 0.5: RGB(255, 255, 0), 1: RGB(255, 0, 0)])
previewlw = CustomPreviewLineweights(Geometry=scale.Geometry, Shader=gradient, Thickness=Slider(3.341, range=0..10), Absolute=False)

# ----
# Colored Lines!
number_slider_2 = Slider(44, range=0..100)
series_4 = Series(Start=0, Step=1, Count=number_slider_2)
X_2 = UnitX(Factor=series_4)
crv_2 = Curve(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)
move_2 = Move(Geometry=crv_2, Motion=X_2)  # -> Geometry, Transform
curvepoint_3 = PointOnCurve(move_2.Geometry, parameter=0.5)
series_5 = Series(Start=0, Step=Slider(4, range=0..10), Count=number_slider_2)
rotate_2 = Rotate(Geometry=move_2.Geometry, Angle=degrees(series_5), Plane=curvepoint_3)  # -> Geometry, Transform
curvepoint_4 = PointOnCurve(rotate_2.Geometry, parameter=0.5)
series_6 = Series(Start=Slider(0.0167, range=0..1), Step=Slider(0.0592, range=0..1), Count=number_slider_2)
scale_2 = Scale(Geometry=rotate_2.Geometry, Center=curvepoint_4, Factor=series_6)  # -> Geometry, Transform
previewlw_2 = CustomPreviewLineweights(Geometry=scale_2.Geometry, Shader=ColourSwatch(SwatchColor=RGB(148, 148, 148)), Absolute=False)

# ----
# Data Recorder Split Colors
number_slider_3 = Slider(31, range=0..100)
series_7 = Series(Start=0, Step=1, Count=number_slider_3)
X_3 = UnitX(Factor=series_7)
crv_3 = Curve(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)
move_3 = Move(Geometry=crv_3, Motion=X_3)  # -> Geometry, Transform
curvepoint_5 = PointOnCurve(move_3.Geometry, parameter=0.5)
series_8 = Series(Start=0, Step=Slider(7.985, range=0..10), Count=number_slider_3)
rotate_3 = Rotate(Geometry=move_3.Geometry, Angle=degrees(series_8), Plane=curvepoint_5)  # -> Geometry, Transform
curvepoint_6 = PointOnCurve(rotate_3.Geometry, parameter=0.5)
series_9 = Series(Start=Slider(0.5041, range=0..1), Step=Slider(0.0493, range=0..1), Count=number_slider_3)
scale_3 = Scale(Geometry=rotate_3.Geometry, Center=curvepoint_6, Factor=series_9)  # -> Geometry, Transform
len_2 = Length(Curve=scale_3.Geometry)
bnd_2 = Bounds(Numbers=len_2)
dedomain_2 = DeconstructDomain(Domain=bnd_2)  # -> Start, End
rec = DataRecorder(scale_3.Geometry, DataLimit=-10, RecordData=True)
gradient_2 = Gradient(
    LowerLimit=dedomain_2.Start,
    UpperLimit=dedomain_2.End,
    Parameter=len_2,
    stops=[0: RGB(0, 128, 0), 0.5: RGB(255, 255, 0), 1: RGB(255, 0, 0)])

# ----
# Data Recorder to Draw!
number_slider_4 = Slider(0, range=0..1)
crv_4 = Curve(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)
curvature = Curvature(Curve=reparameterize(crv_4), Parameter=number_slider_4)  # -> P, K, C
rec_2 = DataRecorder(curvature.P, DataLimit=-10, RecordData=True)
rec_3 = DataRecorder(curvature.K, DataLimit=-10, RecordData=True)
bnd_3 = Bounds(Numbers=rec_3)
dom = ConstructDomain(DomainStart=0, DomainEnd=Slider(7.047, range=0..10))
remap = RemapNumbers(Value=rec_3, Source=bnd_3, Target=dom)  # -> Mapped, Clipped
cir = Circle(Plane=rec_2, Radius=remap.Mapped)
area = Area(Geometry=cir)  # -> Area, Centroid
bnd_4 = Bounds(Numbers=area.Area)
dedomain_3 = DeconstructDomain(Domain=bnd_4)  # -> Start, End
gradient_3 = Gradient(
    LowerLimit=dedomain_3.Start,
    UpperLimit=dedomain_3.End,
    Parameter=area.Area,
    stops=[0: RGB(234, 38, 0), 0.25: RGB(234, 126, 0), 0.5: RGB(254, 244, 84), 0.75: RGB(173, 203, 249), 1: RGB(75, 107, 169)])

previewlw_3 = CustomPreviewLineweights(Geometry=cir, Shader=gradient_3, Thickness=Slider(3.341, range=0..10), Absolute=False)
previewlw_4 = CustomPreviewLineweights(
    Geometry=crv_4,
    Shader=ColourSwatch(SwatchColor=RGB(219, 219, 219)),
    Thickness=Slider(0.522, range=0..10),
    Absolute=False)

previewlw_5 = CustomPreviewLineweights(Geometry=rec, Shader=ColourSwatch(SwatchColor=RGB(219, 219, 219)), Thickness=Slider(0.522, range=0..10), Absolute=False)
previewlw_6 = CustomPreviewLineweights(Geometry=scale_3.Geometry, Shader=gradient_2, Thickness=Slider(3.341, range=0..10), Absolute=False)

# ----
# Building Lines with Lines
number_slider_5 = Slider(24, range=0..50)
crv_5 = Curve(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)
number_slider_6 = Slider(1.962, range=0..100)
divide = DivideCurve(Curve=crv_5, Count=number_slider_5, Kinks=False)  # -> Points, Tangents, Parameters
rev = Reverse(Vector=divide.Tangents)
Z = UnitZ(Factor=1)
vrot = Rotate(Vector=rev, Axis=Z, Angle=degrees(Slider(90, range=0..360)))

line = LineSDL(Start=divide.Points, Direction=divide.Tangents, Length=number_slider_6)

end = EndPoints(Curve=line)  # -> Start, End

line_2 = LineSDL(Start=end.Start, Direction=rev, Length=number_slider_6)

end_2 = EndPoints(Curve=line_2)  # -> Start, End

line_3 = LineSDL(Start=end_2.Start, Direction=vrot, Length=number_slider_6)
