# Grasshopper definition Intro to Grasshopper.gh (Grasshopper 1.0.7)

# ---- group: Primitives
these_are_called_primitives = Line()
line = Line()
line_2 = Line()

# ----
# So what do we need to construct a line?
number_slider = Slider(0, range=0..100)
number_slider_2 = Slider(0, range=0..100)
pt = ConstructPoint(XCoordinate=0, YCoordinate=0, ZCoordinate=0)
planesrf = PlaneSurface(Plane=PlaneXY(0, 0, 0), XSize=Domain(-10, 10), YSize=Domain(-10, 10))

# ---- group: Required Inputs
geo = Geometry()
vec = Vector()
geo_2 = Geometry()
vec_2 = Vector()
move = Move(Motion=Vector(0, 0, 10))  # -> Geometry, Transform

# ----
number_slider_3 = Slider(50, range=0..50)
series = Series(Start=0, Step=Slider(2, range=0..10), Count=number_slider_3)
crv = Curve(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)
X = UnitX(Factor=series)
move_2 = Move(Geometry=crv, Motion=X)  # -> Geometry, Transform
curvepoint = PointOnCurve(move_2.Geometry, parameter=0.5)
series_2 = Series(Start=0, Step=Slider(4, range=0..360), Count=number_slider_3)
rotate = Rotate(Geometry=move_2.Geometry, Angle=degrees(series_2), Plane=curvepoint)  # -> Geometry, Transform

# ---- group: Create a vector
pt_2 = ConstructPoint(XCoordinate=0, YCoordinate=0, ZCoordinate=0)
Y = UnitY(Factor=1)
Z = UnitZ(Factor=1)
X_2 = UnitX(Factor=Slider(48, range=0..100))
vec2pt = Vector2Pt(Unitize=False)  # -> Vector, Length
vdis = VectorDisplay(Anchor=pt_2, Vector=X_2)

# ----
# So what do we need to construct a line?
pt_3 = ConstructPoint(XCoordinate=0, YCoordinate=0, ZCoordinate=0)
pt_4 = ConstructPoint(XCoordinate=0, YCoordinate=0, ZCoordinate=0)
ln = Line(StartPoint=pt_3, EndPoint=pt_4)

# ----
# Lets look at basic transformations!
move_3 = Move(Motion=Vector(0, 0, 10))  # -> Geometry, Transform
move_4 = Move(Motion=Vector(0, 0, 10))  # -> Geometry, Transform

# ----
# Lets look at curve geometry!
eval = EvaluateCurve()  # -> Point, Tangent, Angle
eval_2 = EvaluateCurve()  # -> Point, Tangent, Angle

# ---- group: Understanding the User Interface
ln_2 = Line()
line_3 = Line()
ln_3 = Line()
line_4 = Line()

# ----
# Lets look at surface/brep geometry!
evalsrf = EvaluateSurface()  # -> Point, Normal, UDirection, VDirection, Frame
evalsrf_2 = EvaluateSurface()  # -> Point, Normal, UDirection, VDirection, Frame

# ---- group: You can group things together by selecting and right-clicking > "Add to group"
# Components have inputs ->
# <- and outputs!
ln_4 = Line()

# Components have inputs ->
# <- and outputs!
move_5 = Move(Motion=Vector(0, 0, 10))  # -> Geometry, Transform

# Components have inputs ->
# <- and outputs!
planesrf_2 = PlaneSurface(Plane=PlaneXY(0, 0, 0), XSize=Domain(-10, 10), YSize=Domain(-10, 10))

# ----
# We can also ask our geometry questions
len = Length()
panel = Panel(len)

# ----
# We can also ask our geometry questions
evalsrf_3 = EvaluateSurface()  # -> Point, Normal, UDirection, VDirection, Frame
panel_2 = Panel(evalsrf_3.Point)

# ---- group: Inputs
number_slider_4 = Slider(0.25, range=0..1)
toggle = BooleanToggle(False)

# ----
# Move using a single vector
number_slider_5 = Slider(3, range=0..100)
crv_2 = Curve(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)
X_3 = UnitX(Factor=number_slider_5)
move_6 = Move(Geometry=crv_2, Motion=X_3)  # -> Geometry, Transform

# ----
# Move using two vectors
number_slider_6 = Slider(24, range=0..100)
X_4 = UnitX(Factor=number_slider_6)
Y_2 = UnitY(Factor=number_slider_6)
vec2pt_2 = Vector2Pt(PointA=X_4, PointB=Y_2, Unitize=False)  # -> Vector, Length
move_7 = Move(Geometry=move_6.Geometry, Motion=vec2pt_2.Vector)  # -> Geometry, Transform

# ---- group: Use a series!
# What if I want to use the
# same vector multiple times?
number_slider_7 = Slider(50, range=0..50)
series_3 = Series(Start=0, Step=Slider(1, range=0..10), Count=number_slider_7)
crv_3 = Curve(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)
X_5 = UnitX(Factor=series_3)
move_8 = Move(Geometry=crv_3, Motion=X_5)  # -> Geometry, Transform
