# Grasshopper definition User Inputs_Create Shapes_Working with Inputs.gh (Grasshopper 1.0.7)

# ----
# Create Shapes
# Create geometry in rhino
# and import into grasshopper!
# We will use shapes that you are already drawing in your first assignment!
srf = Surface(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)
# Working With Inputs
crv = Curve([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])

# ----
# User Inputs + Create Shapes + Working with Inputs
# Created by: Michael Hoehn
# Last Modified: 22/01/26
# User Inputs
# Inputs from Rhino into Grasshopper
# In Grasshopper you can bring in any geometry you've made in Rhino using the primitives we studied in the first example!
brep = Brep()
box = Box()
crv_2 = Curve()
srf_2 = Surface()
mesh = Mesh()
geo = Geometry()

# ---- group: You can cast some types of geometry into others automatically!
srf_3 = Surface(crv)

# ----
# You can internalize (save) your geometry for use without being tied directly to a rhino file.
# Right-click and select "set one brep" then "internalise data".
brep_2 = Brep(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)

# ----
# Using the pipeline import, we can automate drawing annotations and modifications!
# By being smart with how you work with inputs, you can create
# an infinite number of drawings with ulimited detail!
# Let's start by tracing a line from our drawings!
# Automatically import your geometry using the pipeline node.
# Let's use our drawings as a starting point!
# Import your drawing into rhino using the "Picture" command
# Create a couple of important layers that you can work with in your geometry pipelines
# Begin to define your algorithms behaviors
pipeline = GeometryPipeline(
    GroupByLayer=False,
    GroupByType=False,
    IncludeHidden=True,
    IncludeLocked=True,
    LayerFilter="MyLines",
    NameFilter="*",
    SublayerFiltering=True,
    TypeFilter=4)
end = EndPoints(Curve=pipeline)  # -> Start, End
polygon = Polygon(Plane=end.End, Radius=Slider(20.07, range=0..100), Segments=6, FilletRadius=0)  # -> Polygon, Length
cir = Circle(Plane=end.Start, Radius=Slider(24.02, range=0..100))

# ----
# Let's create a circle using grasshopper nodes!
number_slider = Slider(100, range=0..100)
pt = ConstructPoint(XCoordinate=0, YCoordinate=0, ZCoordinate=0)
X = UnitX(Factor=number_slider)
move = Move(Geometry=pt, Motion=X)  # -> Geometry, Transform
arrpolar = PolarArray(Geometry=move.Geometry, Plane=pt, Count=Slider(89, range=0..100), Angle=Slider(6.315, range=0..360))  # -> Geometry, Transform
nurbs = NurbsCurve(Vertices=arrpolar.Geometry, Degree=3, Periodic=invert(False))  # -> Curve, Length, Domain

# ---- group: Yellow nodes do not have data!
brep_3 = Brep()

# ---- group: Gray nodes have data!
brep_4 = Brep(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)

# ----
# Create geometry in grasshopper using nodes!
# Most things that you use in this environment can be constructed in grasshopper itself.
# This can be much better for a fully parametric workflow, rather than making new geometry in Rhino all the time.
# All of this for a rectangle??!
number_slider_2 = Slider(100, range=0..100)
pt_2 = ConstructPoint(XCoordinate=0, YCoordinate=0, ZCoordinate=0)
pt_3 = ConstructPoint(XCoordinate=number_slider_2, YCoordinate=0, ZCoordinate=0)
ln = Line(StartPoint=pt_2, EndPoint=pt_3)
end_2 = EndPoints(Curve=ln)  # -> Start, End
Y = UnitY(Factor=1)
line = LineSDL(Start=end_2.End, Direction=Y, Length=number_slider_2)
X_2 = UnitX(Factor=1)
end_3 = EndPoints(Curve=line)  # -> Start, End
rev = Reverse(Vector=X_2)
line_2 = LineSDL(Start=end_3.End, Direction=rev, Length=number_slider_2)
Y_2 = UnitY(Factor=1)
end_4 = EndPoints(Curve=line_2)  # -> Start, End
rev_2 = Reverse(Vector=Y_2)
line_3 = LineSDL(Start=end_4.End, Direction=rev_2, Length=number_slider_2)
merge = Merge(Data1=ln, Data2=line, Data3=line_2, Data4=line_3)
join = JoinCurves(Curves=merge, Preserve=False)
panel = Panel(join)

# ----
# If you want to modify something that's internalised, simply Bake the geometry and reset the node!
crv_bake_me = Curve(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)
# Inputs from You!
crv_modify_the_curve_and_bring_it_back_i = Curve()  # "Crv (modify the curve and bring it back in!)"

pt_4 = ConstructPoint(XCoordinate=0, YCoordinate=0, ZCoordinate=0)
cir_2 = Circle(Plane=pt_4, Radius=Slider(100, range=0..100))

# ----
# Now let's modify the appearance of the path by selecting an
# important attractor point and defining it's relationship to the point
# Using the pipline, dynamically link an important point from your drawing
# Now define the relationship to that point using anything you like!
number_slider_3 = Slider(100, range=0..100)
pipeline_2 = GeometryPipeline(
    GroupByLayer=False,
    GroupByType=False,
    IncludeHidden=True,
    IncludeLocked=True,
    LayerFilter="MyLines1",
    NameFilter="*",
    SublayerFiltering=True,
    TypeFilter=4)
pipeline_3 = GeometryPipeline(
    GroupByLayer=False,
    GroupByType=False,
    IncludeHidden=True,
    IncludeLocked=True,
    LayerFilter="ImportantPoint",
    NameFilter="*",
    SublayerFiltering=True,
    TypeFilter=1)
pt_5 = Point(pipeline_3)
divide = DivideCurve(Curve=pipeline_2, Count=number_slider_3, Kinks=False)  # -> Points, Tangents, Parameters
dist = Distance(PointA=divide.Points, PointB=pt_5)
division = Division(A=dist, B=Slider(8.261, range=1..10))
cir_3 = Circle(Plane=divide.Points, Radius=division)

# ----
# You can use a dynamic pipline to import data dynamically
# This means you can draw in rhino like normal and import things directly into grasshopper algos.
# Make sure you set the type!
# Double-click what you want to import.
pipeline_4 = GeometryPipeline(
    GroupByLayer=False,
    GroupByType=False,
    IncludeHidden=True,
    IncludeLocked=True,
    LayerFilter="*",
    NameFilter="*",
    SublayerFiltering=True,
    TypeFilter=1073741852)

# ----
# There are MANY ways to do the same thing in grasshopper!
number_slider_4 = Slider(100, range=0..100)
rectangle = Rectangle(Plane=PlaneXY(0, 0, 0), XSize=number_slider_4, YSize=number_slider_4, Radius=0)  # -> Rectangle, Length

# ----
# Now let's modify the appearance of the path by selecting an
# important attractor point and defining it's relationship to the point
# Using the pipline, dynamically link an important point from your drawing
# Now define the relationship to that point using anything you like!
number_slider_5 = Slider(100, range=0..100)
pipeline_5 = GeometryPipeline(
    GroupByLayer=False,
    GroupByType=False,
    IncludeHidden=True,
    IncludeLocked=True,
    LayerFilter="MyLines2",
    NameFilter="*",
    SublayerFiltering=True,
    TypeFilter=4)
pipeline_6 = GeometryPipeline(
    GroupByLayer=False,
    GroupByType=False,
    IncludeHidden=True,
    IncludeLocked=True,
    LayerFilter="MyLines3",
    NameFilter="*",
    SublayerFiltering=True,
    TypeFilter=4)
divide_2 = DivideCurve(Curve=pipeline_5, Count=number_slider_5, Kinks=False)  # -> Points, Tangents, Parameters

divide_3 = DivideCurve(Curve=pipeline_6, Count=number_slider_5, Kinks=False)  # -> Points, Tangents, Parameters

ln_2 = Line(StartPoint=divide_2.Points, EndPoint=reverse(divide_3.Points))

len = Length(Curve=ln_2)
bnd = Bounds(Numbers=len)
dom = ConstructDomain(DomainStart=Slider(27.021, range=0..100), DomainEnd=Slider(683.42, range=0..1000))
remap = RemapNumbers(Value=len, Source=bnd, Target=dom)  # -> Mapped, Clipped
Z = UnitZ(Factor=remap.Mapped)
move_2 = Move(Geometry=ln_2, Motion=Z)  # -> Geometry, Transform

merge_2 = Merge(Data1=graft(ln_2), Data2=graft(move_2.Geometry))
loft = Loft(Curves=merge_2, Options={Adjust=False, Closed=False, LoftEnds=0, LoftSimp=0, LoftType=0, Rebuild=10, Refit=0.01})  # -> flatten(Loft)
area = Area(Geometry=loft)  # -> Area, Centroid
bnd_2 = Bounds(Numbers=area.Area)
dedomain = DeconstructDomain(Domain=bnd_2)  # -> Start, End
gradient = Gradient(
    LowerLimit=dedomain.Start,
    UpperLimit=dedomain.End,
    Parameter=area.Area,
    stops=[0: RGB(234, 38, 0), 0.25: RGB(234, 126, 0), 0.5: RGB(254, 244, 84), 0.75: RGB(173, 203, 249), 1: RGB(75, 107, 169)])
preview = CustomPreview(Geometry=loft, Material=gradient)
